# Grasshopper definition My_test.gh (Grasshopper 1.0.7)

geo2_in_px = GetNumber("15", AtLeast=1, AtMost=2147483647, Maximum=1.797693135e+308, Minimum=-1.797693135e+308)
geo2_in_py = GetNumber("15", AtLeast=1, AtMost=2147483647, Maximum=1.797693135e+308, Minimum=-1.797693135e+308)
geo2_in_dy = GetNumber("20", AtLeast=1, AtMost=2147483647, Maximum=1.797693135e+308, Minimum=-1.797693135e+308)
geo2_in_dx = GetNumber("20", AtLeast=1, AtMost=2147483647, Maximum=1.797693135e+308, Minimum=-1.797693135e+308)
geo1_in_dx = GetNumber("20", AtLeast=1, AtMost=2147483647, Maximum=1.797693135e+308, Minimum=-1.797693135e+308)
geo1_in_dy = GetNumber("20", AtLeast=1, AtMost=2147483647, Maximum=1.797693135e+308, Minimum=-1.797693135e+308)
geo1_in_py = GetNumber("0", AtLeast=1, AtMost=2147483647, Maximum=1.797693135e+308, Minimum=-1.797693135e+308)
geo1_in_px = GetNumber("0", AtLeast=1, AtMost=2147483647, Maximum=1.797693135e+308, Minimum=-1.797693135e+308)
construct_point = ConstructPoint(XCoordinate=geo2_in_px, YCoordinate=geo2_in_py, ZCoordinate=0)
construct_point_2 = ConstructPoint(XCoordinate=geo1_in_px, YCoordinate=geo1_in_py, ZCoordinate=0)
xy_plane = XYPlane(Origin=construct_point)
xy_plane_2 = XYPlane(Origin=construct_point_2)
rectangle = Rectangle(Plane=xy_plane, XSize=geo2_in_dx, YSize=geo2_in_dy, Radius=0)  # -> Rectangle, Length
rectangle_2 = Rectangle(Plane=xy_plane_2, XSize=geo1_in_dx, YSize=geo1_in_dy, Radius=0)  # -> Rectangle, Length
region_intersection = RegionIntersection(CurvesA=rectangle_2.Rectangle, CurvesB=rectangle.Rectangle)
area = Area(Geometry=region_intersection)  # -> Area, Centroid

# ---- group: OUT_AREA
number = Number(area.Area)
